# Grasshopper definition Contour_numbering.gh (Grasshopper 1.0.7)

# Right click and reference
# Multiple Geometries*
# from Rhino
# 
# 
# 
# *your contour curves
geo = Geometry([<curve referenced from the Rhino model> x10])
# Determines the length
# of the list of conour curves
lng = ListLength(List=geo)
# Creates a planar surface
# from each contour curve
boundary = BoundarySurfaces(Edges=geo)
# Creates a list of numbers,
# one for each contour curve
series = Series(Start=0, Step=1, Count=lng)
# Locates the center
# point of each surface
area = Area(Geometry=boundary)  # -> Area, Centroid
panel = Panel(series)
# Places a text tag
# (number from the input
# list) at the center of
# each contour curve.
# 
# Right click and BAKE
# these tags to make
# then Rhino objects!
tag = TextTag3D(Location=area.Centroid, Text=series, Size=1, Justification=7)
